# Dynamo graph Facade.dyn (Dynamo 2.2.0.4667)

byCoordinates = Point.ByCoordinates()
number_slider = DoubleSlider(1350, range=0..3000 step 50)
number_slider_2 = DoubleSlider(0, range=0..100 step 0.1)
byCoordinates_2 = Point.ByCoordinates(x=number_slider, y=number_slider_2)
byStartPointEndPoint = Line.ByStartPointEndPoint(startPoint=byCoordinates, endPoint=byCoordinates_2)

# group: Stack Height Coef
stack_height_coef = DoubleSlider(0.19, range=0..0.5 step 0.01)  # graph input

# group: Floor Height
floor_height = DoubleSlider(400, range=0..500 step 5)  # graph input

code_block = CodeBlock(stackHeightCoef=stack_height_coef, floorHeight=floor_height) { stackHeightCoef*floorHeight; }
code_block_2 = CodeBlock(h=code_block) { vec = Vector.ZAxis(); vec.Scale(h); }
translate = Geometry.Translate(geometry=byStartPointEndPoint, direction=code_block_2.out1)
list_create = List.Create(item0=byStartPointEndPoint, item1=translate)
byLoft = Surface.ByLoft(crossSections=list_create)

# group: Number of Vertical Mullions
number_of_vertical_mullions = DoubleSlider(14, range=0..30 step 1)  # graph input

code_block_3 = CodeBlock(n=number_of_vertical_mullions) { 0..1..#n; }
pointAtParameter = Curve.PointAtParameter(curve=translate, param=code_block_3)
code_block_4 = CodeBlock(floorHeight=floor_height, stackHeightCoef=stack_height_coef) { floorHeight - stackHeightCoef*floorHeight; }
code_block_5 = CodeBlock(h=code_block_4) { vec = Vector.ZAxis(); vec.Scale(h); }
translate_2 = Geometry.Translate(geometry=translate, direction=code_block_5.out1)
pointAtParameter_2 = Curve.PointAtParameter(curve=translate_2, param=code_block_3)
byStartPointEndPoint_2 = Line.ByStartPointEndPoint(startPoint=pointAtParameter, endPoint=pointAtParameter_2)

# group: Number of Transoms
number_of_transoms = DoubleSlider(1, range=0..3 step 1)  # graph input

code_block_6 = CodeBlock(n=number_of_transoms) { 0..1..#n + 2; }
code_block_7 = CodeBlock(list=code_block_6) { 0; List.Count(list)-1; }
removeItemAtIndex = List.RemoveItemAtIndex(list=code_block_6, indices=code_block_7.out1)
removeItemAtIndex_2 = List.RemoveItemAtIndex(list=removeItemAtIndex, indices=code_block_7.out0)
pointAtParameter_3 = Curve.PointAtParameter(curve=byStartPointEndPoint_2, param=removeItemAtIndex_2, lacing=CrossProduct)
transpose = List.Transpose(lists=pointAtParameter_3)
restOfItems = List.RestOfItems(list=transpose@L2)
code_block_8 = CodeBlock { 1; }
shiftIndices = List.ShiftIndices(list=transpose@L2, amount=code_block_8)
restOfItems_2 = List.RestOfItems(list=shiftIndices@L2)
byStartPointEndPoint_3 = Line.ByStartPointEndPoint(startPoint=restOfItems, endPoint=restOfItems_2)
length = Curve.Length(curve=byStartPointEndPoint_3)
code_block_9 = CodeBlock { 2; }
flatten = List.Flatten(list=length, amt=code_block_9)

# group: Transoms Length
sum = Math.Sum(values=flatten)

code_block_10 = CodeBlock { 0; 1; }
getItemAtIndex = List.GetItemAtIndex(list=pointAtParameter, index=code_block_10.out0)
getItemAtIndex_2 = List.GetItemAtIndex(list=pointAtParameter, index=code_block_10.out1)
byStartPointEndPoint_4 = Line.ByStartPointEndPoint(startPoint=getItemAtIndex, endPoint=getItemAtIndex_2)
length_2 = Curve.Length(curve=byStartPointEndPoint_4)

# group: Vertical Profiles Length
sum_2 = Math.Sum(values=length_2)

firstItem = List.FirstItem(list=length_2)
code_block_11 = CodeBlock(l=firstItem) { (l<100)?8:((l<150)?10:((l<200)?12:((l<250)?16:18))); }
code_block_12 = CodeBlock { 70; }
byCoordinates_3 = Point.ByCoordinates(y=code_block_12)
code_block_13 = CodeBlock { 120; }
byCoordinates_4 = Point.ByCoordinates(y=code_block_13)
byStartPointEndPoint_5 = Line.ByStartPointEndPoint(startPoint=byCoordinates_3, endPoint=byCoordinates_4)
number_slider_3 = DoubleSlider(63.955, range=0..100 step 0.1)
number_slider_4 = DoubleSlider(99.246, range=0..143.666 step 0.1)
byCoordinates_5 = Point.ByCoordinates(x=number_slider_3, y=number_slider_4)
number_slider_5 = DoubleSlider(225.992, range=0..240.208 step 0.1)
number_slider_6 = DoubleSlider(74.119, range=0..153.078 step 0.1)
byCoordinates_6 = Point.ByCoordinates(x=number_slider_5, y=number_slider_6)
code_block_14 = CodeBlock { 350; }
byCoordinates_7 = Point.ByCoordinates(x=code_block_14, y=code_block_12)
list_create_2 = List.Create(item0=byCoordinates_4, item1=byCoordinates_5, item2=byCoordinates_6, item3=byCoordinates_7)
byPoints = NurbsCurve.ByPoints(points=list_create_2)
byStartPointEndPoint_6 = Line.ByStartPointEndPoint(startPoint=byCoordinates_3, endPoint=byCoordinates_7)
list_create_3 = List.Create(item0=byStartPointEndPoint_5, item1=byPoints, item2=byStartPointEndPoint_6)
color_palette = ColorPalette({R: 106, G: 90, B: 205, A: 255})
byGeometryColor = Modifiers.GeometryColor.ByGeometryColor(geometry=list_create_3, color=color_palette, lacing=CrossProduct)
number_slider_7 = DoubleSlider(-500, range=-539.821..100 step 0.1)
number_slider_8 = DoubleSlider(101, range=0..107.072 step 0.1)
byCoordinates_8 = Point.ByCoordinates(x=number_slider_7, y=number_slider_8)
number_slider_9 = DoubleSlider(-496.021, range=-539.821..100 step 0.1)
number_slider_10 = DoubleSlider(95.397, range=0..107.072 step 0.1)
byCoordinates_9 = Point.ByCoordinates(x=number_slider_9, y=number_slider_10)
number_slider_11 = DoubleSlider(-487.721, range=-539.821..100 step 0.1)
number_slider_12 = DoubleSlider(81.9, range=0..107.072 step 0.1)
byCoordinates_10 = Point.ByCoordinates(x=number_slider_11, y=number_slider_12)
number_slider_13 = DoubleSlider(-480, range=-539.821..100 step 0.1)
number_slider_14 = DoubleSlider(75, range=0..107.072 step 0.1)
byCoordinates_11 = Point.ByCoordinates(x=number_slider_13, y=number_slider_14)
number_slider_15 = DoubleSlider(-470.103, range=-539.821..100 step 0.1)
number_slider_16 = DoubleSlider(78.755, range=0..107.072 step 0.1)
byCoordinates_12 = Point.ByCoordinates(x=number_slider_15, y=number_slider_16)
number_slider_17 = DoubleSlider(-459.878, range=-539.821..100 step 0.1)
number_slider_18 = DoubleSlider(84.188, range=0..107.072 step 0.1)
byCoordinates_13 = Point.ByCoordinates(x=number_slider_17, y=number_slider_18)
number_slider_19 = DoubleSlider(-450, range=-539.821..100 step 0.1)
number_slider_20 = DoubleSlider(87, range=0..107.072 step 0.1)
byCoordinates_14 = Point.ByCoordinates(x=number_slider_19, y=number_slider_20)
list_create_4 = List.Create(item0=byCoordinates_8, item1=byCoordinates_9, item2=byCoordinates_10, item3=byCoordinates_11, item4=byCoordinates_12, item5=byCoordinates_13, item6=byCoordinates_14)
byPoints_2 = NurbsCurve.ByPoints(points=list_create_4)
color_palette_2 = ColorPalette({R: 46, G: 139, B: 87, A: 255})
byGeometryColor_2 = Modifiers.GeometryColor.ByGeometryColor(geometry=byPoints_2, color=color_palette_2, lacing=CrossProduct)
pointAtSegmentLength = Curve.PointAtSegmentLength(curve=byStartPointEndPoint_6, segmentLength=length_2)
YAxis = Vector.YAxis()
project = Point.Project(point=pointAtSegmentLength, baseGeometry=byPoints, projectionDirection=YAxis)
Y = Point.Y(point=project)

# group: kg/m2 Al
code_block_15 = CodeBlock(n=Y) { n/10; }

number_slider_21 = DoubleSlider(-240, range=-240..100 step 0.1)
byCoordinates_15 = Point.ByCoordinates(x=number_slider_21)
number_slider_22 = DoubleSlider(-40, range=-240..100 step 0.1)
byCoordinates_16 = Point.ByCoordinates(x=number_slider_22)
byStartPointEndPoint_7 = Line.ByStartPointEndPoint(startPoint=byCoordinates_15, endPoint=byCoordinates_16)
pointAtSegmentLength_2 = Curve.PointAtSegmentLength(curve=byStartPointEndPoint_7, segmentLength=length_2)
number_slider_23 = DoubleSlider(-240, range=-240..100 step 0.1)
number_slider_24 = DoubleSlider(99, range=0..109.413 step 0.1)
byCoordinates_17 = Point.ByCoordinates(x=number_slider_23, y=number_slider_24)
number_slider_25 = DoubleSlider(-199.669, range=-240..100 step 0.1)
number_slider_26 = DoubleSlider(86.4, range=0..128.059 step 0.1)
byCoordinates_18 = Point.ByCoordinates(x=number_slider_25, y=number_slider_26)
number_slider_27 = DoubleSlider(-140, range=-240..100 step 0.1)
number_slider_28 = DoubleSlider(95, range=0..117 step 0.1)
byCoordinates_19 = Point.ByCoordinates(x=number_slider_27, y=number_slider_28)
number_slider_29 = DoubleSlider(-85.2, range=-240..100 step 0.1)
number_slider_30 = DoubleSlider(108.2, range=0..117 step 0.1)
byCoordinates_20 = Point.ByCoordinates(x=number_slider_29, y=number_slider_30)
number_slider_31 = DoubleSlider(-40, range=-240..100 step 0.1)
number_slider_32 = DoubleSlider(115.3, range=0..147.041 step 0.1)
byCoordinates_21 = Point.ByCoordinates(x=number_slider_31, y=number_slider_32)
list_create_5 = List.Create(item0=byCoordinates_17, item1=byCoordinates_18, item2=byCoordinates_19, item3=byCoordinates_20, item4=byCoordinates_21)
byPoints_3 = NurbsCurve.ByPoints(points=list_create_5)
number_slider_33 = DoubleSlider(-240, range=-240..100 step 0.1)
number_slider_34 = DoubleSlider(92, range=0..109.413 step 0.1)
byCoordinates_22 = Point.ByCoordinates(x=number_slider_33, y=number_slider_34)
number_slider_35 = DoubleSlider(-199.669, range=-240..100 step 0.1)
number_slider_36 = DoubleSlider(91.098, range=0..128.059 step 0.1)
byCoordinates_23 = Point.ByCoordinates(x=number_slider_35, y=number_slider_36)
number_slider_37 = DoubleSlider(-140, range=-240..100 step 0.1)
number_slider_38 = DoubleSlider(100, range=0..117 step 0.1)
byCoordinates_24 = Point.ByCoordinates(x=number_slider_37, y=number_slider_38)
number_slider_39 = DoubleSlider(-40, range=-240..100 step 0.1)
number_slider_40 = DoubleSlider(125.619, range=0..147.041 step 0.1)
byCoordinates_25 = Point.ByCoordinates(x=number_slider_39, y=number_slider_40)
list_create_6 = List.Create(item0=byCoordinates_22, item1=byCoordinates_23, item2=byCoordinates_24, item3=byCoordinates_25)
byPoints_4 = NurbsCurve.ByPoints(points=list_create_6)
number_slider_41 = DoubleSlider(-240, range=-240..100 step 0.1)
number_slider_42 = DoubleSlider(100, range=0..109.413 step 0.1)
byCoordinates_26 = Point.ByCoordinates(x=number_slider_41, y=number_slider_42)
number_slider_43 = DoubleSlider(-199.097, range=-240..100 step 0.1)
number_slider_44 = DoubleSlider(99.5, range=0..128.059 step 0.1)
byCoordinates_27 = Point.ByCoordinates(x=number_slider_43, y=number_slider_44)
number_slider_45 = DoubleSlider(-140, range=-240..100 step 0.1)
number_slider_46 = DoubleSlider(108, range=0..117 step 0.1)
byCoordinates_28 = Point.ByCoordinates(x=number_slider_45, y=number_slider_46)
number_slider_47 = DoubleSlider(-40, range=-240..100 step 0.1)
number_slider_48 = DoubleSlider(139.3, range=0..147.041 step 0.1)
byCoordinates_29 = Point.ByCoordinates(x=number_slider_47, y=number_slider_48)
list_create_7 = List.Create(item0=byCoordinates_26, item1=byCoordinates_27, item2=byCoordinates_28, item3=byCoordinates_29)
byPoints_5 = NurbsCurve.ByPoints(points=list_create_7)
number_slider_49 = DoubleSlider(-240, range=-240..100 step 0.1)
number_slider_50 = DoubleSlider(108, range=0..109.413 step 0.1)
byCoordinates_30 = Point.ByCoordinates(x=number_slider_49, y=number_slider_50)
number_slider_51 = DoubleSlider(-199.097, range=-240..100 step 0.1)
number_slider_52 = DoubleSlider(107.371, range=0..128.059 step 0.1)
byCoordinates_31 = Point.ByCoordinates(x=number_slider_51, y=number_slider_52)
number_slider_53 = DoubleSlider(-140, range=-240..100 step 0.1)
number_slider_54 = DoubleSlider(117, range=0..117 step 0.1)
byCoordinates_32 = Point.ByCoordinates(x=number_slider_53, y=number_slider_54)
number_slider_55 = DoubleSlider(-40, range=-240..100 step 0.1)
number_slider_56 = DoubleSlider(147.041, range=0..147.041 step 0.1)
byCoordinates_33 = Point.ByCoordinates(x=number_slider_55, y=number_slider_56)
list_create_8 = List.Create(item0=byCoordinates_30, item1=byCoordinates_31, item2=byCoordinates_32, item3=byCoordinates_33)
byPoints_6 = NurbsCurve.ByPoints(points=list_create_8)
code_block_16 = CodeBlock(t=number_of_transoms, l4=byPoints_3, l3=byPoints_4, l2=byPoints_5, l1=byPoints_6) { t==0?l4:(t==1?l3:(t==2?l2:l1)); }
YAxis_2 = Vector.YAxis()
project_2 = Point.Project(point=pointAtSegmentLength_2, baseGeometry=code_block_16, projectionDirection=YAxis_2)
Y_2 = Point.Y(point=project_2)

# group: transom Coef
coef_transom = CodeBlock(y=Y_2) { y / 100; }

number_slider_57 = DoubleSlider(-500, range=-539.821..100 step 0.1)
byCoordinates_34 = Point.ByCoordinates(x=number_slider_57)
number_slider_58 = DoubleSlider(-450, range=-450..100 step 0.1)
byCoordinates_35 = Point.ByCoordinates(x=number_slider_58)
byStartPointEndPoint_8 = Line.ByStartPointEndPoint(startPoint=byCoordinates_34, endPoint=byCoordinates_35)
code_block_17 = CodeBlock(stackHeight=stack_height_coef) { stackHeight * 100; }
pointAtSegmentLength_3 = Curve.PointAtSegmentLength(curve=byStartPointEndPoint_8, segmentLength=code_block_17)
YAxis_3 = Vector.YAxis()
project_3 = Point.Project(point=pointAtSegmentLength_3, baseGeometry=byPoints_2, projectionDirection=YAxis_3)
Y_3 = Point.Y(point=project_3)

# group: Stack Coef
code_block_18 = CodeBlock(n=Y_3) { n/100; }

# group: Al kg/m2
code_block_19 = CodeBlock(mass=code_block_15, cTransom=coef_transom, cStackH=code_block_18) { mass * cTransom * cStackH; }

firstItem_2 = List.FirstItem(list=code_block_19)
al_kg_m2 = Watch(firstItem_2)  # graph output
restOfItems_3 = List.RestOfItems(list=byStartPointEndPoint_2)
code_block_20 = CodeBlock { 1; }
shiftIndices_2 = List.ShiftIndices(list=byStartPointEndPoint_2, amount=code_block_20)
restOfItems_4 = List.RestOfItems(list=shiftIndices_2)
list_create_9 = List.Create(item0=restOfItems_3, item1=restOfItems_4)
transpose_2 = List.Transpose(lists=list_create_9)
byLoft_2 = Surface.ByLoft(crossSections=transpose_2)
area = Surface.Area(surface=byLoft_2)

# group: Glass Area
sum_3 = Math.Sum(values=area)

code_block_21 = CodeBlock(area=sum_3) { area/10000; }

# group: Glass Cost m2
code_block_22 = CodeBlock(l=firstItem) { (l<100)?20:((l<150)?30:((l<200)?40:((l<250)?45:50))); }

# group: Total Glass Cost
code_block_23 = CodeBlock(area=code_block_21, cost=code_block_22) { area*cost; }

total_glass_cost = Watch(code_block_23)  # graph output
